# Grasshopper definition View_to_the_Outdoors_Through_a_Facade.gh (Grasshopper 1.0.7)

facade_geometry3 = Brep([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])
# Facade
# Options
facade_geometry1 = Brep([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])
facade_geometry2 = Brep([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])

opaque_geometry = Brep(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)
grid_size = Panel("0.25")
# Other
# Inputs
test_surface = Brep(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)

facade_geometry = Brep(facade_geometry3)

debrep = DeconstructBrep(Brep=facade_geometry)  # -> Faces, Edges, Vertices
geometry = Geometry([debrep.Faces, debrep.Edges])

viewpercent = LBViewPercent(
    view_type="Horizontal30DegreeOffset",
    resolution="5",
    geometry=flatten(test_surface),
    context=flatten([facade_geometry, opaque_geometry]),
    grid_size=grid_size,
    run=Toggle(True))  # -> report, points, view_vecs, results, mesh, legend, title, int_mtx; plug-in component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
