# Grasshopper definition apply_metadata.gh (Grasshopper 1.0.8)
# plug-ins: LadybugGrasshopper

domain_box = DomainBox(Base=PlaneXY(0, 0, 0), X="4", Y="4", Z="4")
panel = Panel("https://climate.onebuilding.org/WMO_Region_2_Asia/CHN_China/SH_Shanghai/CHN_SH_Shanghai-Hongqiao.Intl.AP.583670_TMYx.zip")
roomsolid = HBRoomFromSolid(geo=flatten(domain_box), name="Test_Room", conditioned=True)  # -> out, rooms; plug-in component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
simoutput = HBSimulationOutput(surface_temperature=Toggle(True))  # -> out, sim_output; plug-in component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
downloadepw = LBDownloadWeather(weather_URL=panel)  # -> epw_file, stat_file, ddy_file; plug-in component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
model = HBModel(rooms=flatten(roomsolid.rooms), name="Test_Model")  # -> out, model; plug-in component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
simpar = HBSimulationParameter(output=simoutput.sim_output, timestep=6)  # -> sim_par; plug-in component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
lb_falsestart_toggle = LBFalseStartToggle(False)
modeltoosm = HBModelToOSM(model=model.model, epw_file=downloadepw.epw_file, sim_par=simpar, write=lb_falsestart_toggle, run=lb_falsestart_toggle)  # -> out, jsons, osw, osm, idf, sql, zsz, rdd, html; plug-in component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
facesbytype = HBFacesByType(hb_objs=model.model)  # -> walls, interior_walls, roofs, ceilings, exterior_floors, interior_floors, air_walls, apertures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; plug-in component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
faceresult = HBReadFaceResult(sql=modeltoosm.sql)  # -> face_indoor_temp, face_outdoor_temp, face_energy_flow; plug-in component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

# ----
# Enter "type: " to modify the legend display of the data in the Monthly Chart.
# 
# This is helpful when processing a large amount of similar data in batches.
hb_face_attributes = HBFaceAttributes({"Display Name": "display_name", "Simulation Name (Identifier)": "identifier", "Boundary Condition": "boundary_condition", "Has Parent": "has_parent", "Parent": "parent", "Azimuth": "azimuth", "Altitude": "altitude", "Area": "area", "Perimeter": "perimeter", "Face Type": "type", "Aperture Is Operable": "is_operable", "Door Is Glass": "is_glass"}, selected="Azimuth")
face = Data(facesbytype.walls)
face_2 = Data(facesbytype.walls)
faceresultbytype = HBFaceResultByType(data=faceresult.face_outdoor_temp, hb_objs=face_2)  # -> walls, interior_walls, roofs, ceilings, exterior_floors, interior_floors, apertures, interior_apertures, doors, interior_doors; plug-in component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
lablefaces = HBLabelFaces(hb_objs=flatten(face), attribute=hb_face_attributes)  # -> label_text, base_pts, labels, wire_frame; plug-in component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
timeop = LBTimeIntervalOperation(data=faceresultbytype.walls)  # -> daily, monthly, mon_per_hr; plug-in component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
concatenate = Concatenate(FragmentA="type:Face_Azimuth_", FragmentB=lablefaces.label_text)
graft_tree = GraftTree(Tree=timeop.mon_per_hr, IncludeEmptyLists=True, IncludeNullItems=True)
graft_tree_2 = GraftTree(Tree=concatenate, IncludeEmptyLists=True, IncludeNullItems=True)
applymeta = LBApplyMetadata(data=graft_tree, metadata=graft_tree_2)  # -> data; plug-in component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
flatten_tree = FlattenTree(Tree=applymeta, Path="{0}")
monthlychart = LBMonthlyChart(data=flatten_tree)  # -> out, data_mesh, data_lines, col_lines, legend, borders, labels, y_title, title, vis_set; plug-in component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

# ----
# Enter "Zone: " to bind the data to the HB Room.
# 
# Visualization can be achieved using HB Color Room.
hb_face_attributes_2 = HBFaceAttributes({"Display Name": "display_name", "Simulation Name (Identifier)": "identifier", "Boundary Condition": "boundary_condition", "Has Parent": "has_parent", "Parent": "parent", "Azimuth": "azimuth", "Altitude": "altitude", "Area": "area", "Perimeter": "perimeter", "Face Type": "type", "Aperture Is Operable": "is_operable", "Door Is Glass": "is_glass"}, selected="Simulation Name (Identifier)")
face_3 = Data(facesbytype.walls)
lablefaces_2 = HBLabelFaces(hb_objs=face_3, attribute=hb_face_attributes_2)  # -> label_text, base_pts, labels, wire_frame; plug-in component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
concatenate_2 = Concatenate(FragmentA="Surface:", FragmentB=lablefaces_2.label_text)
data = Data(faceresultbytype.walls)
face_4 = Data(facesbytype.walls)

applymeta_2 = LBApplyMetadata(data=data, metadata=concatenate_2)  # -> data; plug-in component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

colorfaces = HBColorFaces(data=flatten(applymeta_2), hb_objs=flatten(face_4))  # -> readMe, mesh, wire_frame, legend, title, faces, colors, values, vis_set; plug-in component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
