# Grasshopper definition estimate_glare_potential_over_a_year.gh (Grasshopper 1.0.7)

# https://hydrashare.github.io/hydra/viewer?owner=chriswmackey&fork=hydra_2&id=Estimate_Glare_Potential_Over_a_Year&slide=0&scale=2.0000000000000036&offset=-1105.817984007771,-254.51180601648616
# FIX DOCSTRING
panel = Panel("https://energyplus-weather.s3.amazonaws.com/north_and_central_america_wmo_region_4/USA/FL/USA_FL_Jacksonville.NAS.722065_TMY3/USA_FL_Jacksonville.NAS.722065_TMY3.zip")
downloadepw = LBDownloadWeather(weather_URL=panel)  # -> epw_file, stat_file, ddy_file; plug-in component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
analysisperiod = LBAnalysisPeriod(start_month=1, start_day=1, start_hour=0)  # -> period, hoys, dates; plug-in component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
importloc = LBImportLocation(epw_file=downloadepw.epw_file)  # -> location; plug-in component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
sunpath = LBSunPath(location=importloc, hoys=analysisperiod.hoys, scale="0.08")  # -> out, vectors, altitudes, azimuths, hoys, sun_pts, analemma, daily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; plug-in component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
geometry = Geometry([sunpath.analemma, sunpath.compass, sunpath.daily, sunpath.title, sunpath.legend])
opaque_geometry = Brep([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])
run = BooleanToggle(True)
test_surface = Brep(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)
directsunhours = LBDirectSunHours(
    vectors=flatten(sunpath.vectors),
    geometry=flatten(test_surface),
    context=flatten(opaque_geometry),
    grid_size="0.25",
    run=run)  # -> out, points, results, mesh, legend, title, int_mtx; plug-in component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
xmatrix = LBDeconstructMatrix(matrix=flatten(directsunhours.int_mtx))  # -> values; plug-in component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
