# Grasshopper definition glare_shade_benefit.gh (Grasshopper 1.0.7)

# ----
# Get Sun Vectors to Block
panel = Panel("https://energyplus-weather.s3.amazonaws.com/north_and_central_america_wmo_region_4/USA/NY/USA_NY_New.York-J.F.Kennedy.Intl.AP.744860_TMY3/USA_NY_New.York-J.F.Kennedy.Intl.AP.744860_TMY3.zip")
downloadepw = LBDownloadWeather(weather_URL=panel)  # -> epw_file, stat_file, ddy_file; plug-in component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
analysisperiod = LBAnalysisPeriod(start_month=1, start_day=1, start_hour=0, timestep="6")  # -> period, hoys, dates; plug-in component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
importloc = LBImportLocation(epw_file=downloadepw.epw_file)  # -> location; plug-in component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
sunpath = LBSunPath(location=importloc, hoys=analysisperiod.hoys, scale="0.25")  # -> report, vectors, altitudes, azimuths, hoys, sun_pts, analemma, daily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; plug-in component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

geo = Geometry(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)
preview = CustomPreview(Geometry=geo, Material=ColourSwatch(SwatchColor=RGB(0, 0, 0)))

geo_2 = Geometry(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)
pt = Point(Point(2.5, 0.3162992699, 1.7376125))
geo_3 = Geometry(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)
vec = Vector(Vector(0, -0.6002275249, 0))
shadebenefit = LBShadeBenefit(
    vectors=sunpath.vectors,
    study_points=pt,
    study_directs=vec,
    shade_geo=geo_3,
    context=geo_2,
    grid_size="0.2",
    timestep="6",
    run=Toggle(False))  # -> report, mesh, legend, title, shade_help; plug-in component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
vdis = VectorDisplay(Anchor=pt, Vector=vec)

# ----
# Pull Out The Areas Where Shade is Most Desirable
number_slider = Slider(37, range=0..100)
meshselector = LBMeshThresholdSelector(values=shadebenefit.shade_help, mesh=shadebenefit.mesh, pct_threshold=number_slider)  # -> report, total_value, total_area, sub_mesh, outline; plug-in component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
panel_2 = Panel(meshselector.total_area)
panel_3 = Panel(meshselector.total_value)
