# Grasshopper definition radiation_benefit_on_sunpath.gh (Grasshopper 1.0.7)

# ----
# Download and Import EPW
panel = Panel("https://energyplus-weather.s3.amazonaws.com/north_and_central_america_wmo_region_4/USA/MA/USA_MA_Boston-Logan.Intl.AP.725090_TMY3/USA_MA_Boston-Logan.Intl.AP.725090_TMY3.zip")
downloadepw = LBDownloadWeather(weather_URL=panel)  # -> epw_file, stat_file, ddy_file; plug-in component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
importepw = LBImportEPW(epw_file=downloadepw.epw_file)  # -> location, dry_bulb_temperature, dew_point_temperature, relative_humidity, wind_speed, wind_direction, direct_normal_rad, diffuse_horizontal_rad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; plug-in component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

building_balance_point = Slider(15, range=10..20)
benefitmatrix = LBBenefitSkyMatrix(
    location=importepw.location,
    temperature=importepw.dry_bulb_temperature,
    bal_temp=building_balance_point,
    direct_rad=importepw.direct_normal_rad,
    diffuse_rad=importepw.diffuse_horizontal_rad)  # -> report, sky_mtx; plug-in component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

pt = Point(Point(209.9418744, 195.2042226, 0))

# ----
# Shading Mask for Context
brep = Brep([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])
edges = BrepEdges(Brep=brep)  # -> Naked, Interior, NonManifold
symask = LBSkyMask(context=brep, density="3", center=pt, projection="Stereographic")  # -> report, context_mask, orient_mask, strategy_mask, sky_mask, context_view, orient_view, strategy_view, sky_view; plug-in component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
move = Move(Geometry=symask.context_mask, Motion="0,0,0.5")  # -> Geometry, Transform

# ----
# SunPath and Radiation Dome
sunpath = LBSunPath(location=importepw.location, center_pt=pt, scale=1, projection="Stereographic")  # -> report, vectors, altitudes, azimuths, hoys, sun_pts, analemma, daily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; plug-in component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
skydome = LBSkyDome(sky_mtx=benefitmatrix.sky_mtx, center_pt=pt, projection="Stereographic")  # -> report, mesh, compass, legend, title, patch_vecs, patch_values, mesh_values, vis_set; plug-in component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
geo = Geometry([skydome.mesh, skydome.legend])
