# Grasshopper definition radiation_study.gh (Grasshopper 1.0.7)

# ----
# Import Location from EPW File
panel = Panel("http://climate.onebuilding.org/WMO_Region_4_North_and_Central_America/USA_United_States_of_America/WI_Wisconsin/USA_WI_Madison-Dane.County.Rgnl.AP-Truax.Field.726410_TMY3.zip")
downloadepw = LBDownloadWeather(weather_URL=panel)  # -> epw_file, stat_file, ddy_file; plug-in component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
importepw = LBImportEPW(epw_file=downloadepw.epw_file)  # -> location, dry_bulb_temperature, dew_point_temperature, relative_humidity, wind_speed, wind_direction, direct_normal_rad, diffuse_horizontal_rad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; plug-in component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

# ----
# Analysis Period for
# Summer Solstice
panel_2 = Panel("6")
analysisperiod = LBAnalysisPeriod(start_month=panel_2, start_day="21", start_hour=0, end_month=panel_2, end_day="21")  # -> period, hoys, dates; plug-in component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

# ----
# Create Sky Matrix
panel_3 = Panel("20")
skymatrix = LBCumulativeSkyMatrix(
    north=panel_3,
    location=importepw.location,
    direct_rad=importepw.direct_normal_rad,
    diffuse_rad=importepw.diffuse_horizontal_rad,
    hoys=analysisperiod.hoys)  # -> report, sky_mtx; plug-in component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

# ---- group: Run Me!
toggle = BooleanToggle(False)

# ----
# Run Radiation Study
geo = Geometry(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)
geo_2 = Geometry(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)
incidentradiation = LBIncidentRadiation(sky_mtx=skymatrix.sky_mtx, geometry=flatten(geo), context=flatten(geo_2), grid_size="1", offset_dist="0.1", run=toggle)  # -> report, points, results, total, mesh, legend, title, int_mtx; plug-in component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

# ----
# Visualize Sky Matrix
skydome = LBSkyDome(sky_mtx=skymatrix.sky_mtx)  # -> report, mesh, compass, legend, title, patch_vecs, patch_values, mesh_values; plug-in component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
