# Grasshopper definition visualization_set.gh (Grasshopper 1.0.7)

# ----
# Import Weather Data Location
panel = Panel("https://energyplus-weather.s3.amazonaws.com/north_and_central_america_wmo_region_4/USA/NY/USA_NY_New.York-J.F.Kennedy.Intl.AP.744860_TMY3/USA_NY_New.York-J.F.Kennedy.Intl.AP.744860_TMY3.zip")
downloadepw = LBDownloadWeather(weather_URL=panel)  # -> epw_file, stat_file, ddy_file; plug-in component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
importloc = LBImportLocation(epw_file=downloadepw.epw_file)  # -> location; plug-in component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

analysisperiod = LBAnalysisPeriod(start_month="6", start_day="21", start_hour=0, end_month="6", end_day="21")  # -> period, hoys, dates; plug-in component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

sunpath = LBSunPath(location=importloc, hoys=analysisperiod.hoys, scale=1, projection="Stereographic")  # -> report, vectors, altitudes, azimuths, hoys, sun_pts, analemma, daily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; plug-in component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
visset = LBPreviewVisualizationSet(vis_set=sunpath.vis_set, bake=Button())  # plug-in component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
